# Grasshopper definition DRVaa.gh (Grasshopper 1.0.8)
# plug-ins: CORE.Toolbox.Grasshopper, Urbano2, Urbano, Human, Heron, MetaHopper

panel = Panel("34.053051")  # disabled
panel_2 = Panel("-118.261245")  # disabled
panel_3 = Panel("-118.244401")  # disabled
panel_4 = Panel("34.044979")  # disabled
geographic_boundary = GeographicBoundary(Left=panel_2, Top=panel, Right=panel_3, Bottom=panel_4)  # -> Boundary, CoordinateReference; disabled
path = FilePath("C:\Users\l03063058\OneDrive - Instituto Tecnologico y de Estudios Superiores de Monterrey\TEC stuff\RESEARCH\10_experienceRouter\04_tool\01_DRVaa\Grasshopper\")  # disabled
panel_5 = Panel(geographic_boundary.Boundary)  # disabled
create_project_setting = CreateProjectSetting(
    Directory=path,
    Boundary=geographic_boundary.Boundary,
    Granularity="Block",
    DataLayers="osm",
    CoordinateReference=geographic_boundary.CoordinateReference)  # disabled
osm_feature_query = OsmFeatureQuery(OsmFeatureQuery=["building=*", "building:part=*", "building:parts=*"])  # disabled
osm_feature_query_2 = OsmFeatureQuery(OsmFeatureQuery=["highway=motorway", "highway=trunk", "highway=primary", "highway=secondary", "highway=tertiary", "highway=unclassified", "highway=residential", "highway=service", "highway=motorway_link", "highway=trunk_link", "highway=primary_link", "highway=secondary_link", "highway=motorway_junction", "highway=yes", "highway=road", "highway=living street", "highway=footway", "highway=pedestrian", "highway=path", "highway=bridleway", "highway=cycleway", "highway=raceway", "highway=steps"])  # disabled
path_2 = FilePath("C:\Users\l03063058\Desktop\tec_lo.osm")  # disabled
osm_feature_query_3 = OsmFeatureQuery(OsmFeatureQuery=["building=*", "building:part=*", "building:parts=*"])  # disabled
osm_feature_query_4 = OsmFeatureQuery(OsmFeatureQuery=["highway=motorway", "highway=trunk", "highway=primary", "highway=secondary", "highway=tertiary", "highway=unclassified", "highway=residential", "highway=service", "highway=motorway_link", "highway=trunk_link", "highway=primary_link", "highway=secondary_link", "highway=motorway_junction", "highway=yes", "highway=road", "highway=living street", "highway=footway", "highway=pedestrian", "highway=path", "highway=bridleway", "highway=cycleway", "highway=raceway", "highway=steps"])  # disabled
panel_6 = Panel(create_project_setting)  # disabled

# ---- group: INPUT
path_3 = FilePath("C:\Users\l03063058\Desktop\Github\DRVaa\Grasshopper\cityModels\SJO_match_large.osm")
panel_7 = Panel(path_3)

# ----
toggle = BooleanToggle(True)  # disabled
route_biases = RouteBiases()  # -> RouteBias, Point, CoordinateReference; disabled
# URBANO 1
panel_8 = Panel(path_3)
path_4 = FilePath("C:\Users\l03063058\OneDrive - Instituto Tecnologico y de Estudios Superiores de Monterrey\TEC stuff\RESEARCH\10_experienceRouter\04_tool\01_DRVaa\Grasshopper\mapLA.osm")  # disabled
project_setting = ProjectSetting(Json=create_project_setting, Run=toggle)  # disabled
import_osm_file = ImportOSMFile(OsmFilePath=path_4, OsmFeatures=osm_feature_query, Terrain=False, Run=True)  # -> Polylines, Polygons, Points, CoordinateReference, Boundary; disabled
importosm = ImportOSMFeatures(OSMPathOrURL=path_2, OSMFeatureType="building", Format="xml", ImportAltitude=False)  # -> Points, Metadata, UTMZone, TranslationVector; disabled
importosm_2 = ImportOSMFeatures(OSMPathOrURL=path_2, OSMFeatureType="amenity", Format="xml", ImportAltitude=False)  # -> Points, Metadata, UTMZone, TranslationVector; disabled
importosm_3 = ImportOSMFeatures(OSMPathOrURL=path_2, OSMFeatureType="street", Format="xml", ImportAltitude=False)  # -> Points, Metadata, UTMZone, TranslationVector; disabled
meta = CreateMetadata()  # disabled
draw_map = DrawMap()  # disabled
import_osm_file_2 = ImportOSMFile(OsmFilePath=path_4, OsmFeatures=osm_feature_query_4, Terrain=False, Run=True)  # -> Polylines, Polygons, Points, CoordinateReference, Boundary; disabled
geographic_boundary_2 = GeographicBoundary()  # -> Boundary, CoordinateReference; disabled
projbound = ProjectGeographicBoundary()  # -> Boundary, Geometry, CoordinateReference; disabled

importosm_4 = ImportOSMFeatures(OSMPathOrURL=path_3, OSMFeatureType="building", Format="xml", ImportAltitude=False)  # -> Points, Metadata, UTMZone, TranslationVector
importosm_5 = ImportOSMFeatures(OSMPathOrURL=path_3, OSMFeatureType="street", Format="xml", ImportAltitude=False)  # -> Points, Metadata, UTMZone, TranslationVector
importosm_6 = ImportOSMFeatures(OSMPathOrURL=path_3, OSMFeatureType="amenity", Format="xml", ImportAltitude=False)  # -> Points, Metadata, UTMZone, TranslationVector
pline = PolyLine(Vertices=importosm_4.Points, Closed=False)
pline_2 = PolyLine(Vertices=importosm_5.Points, Closed=False)
amen = CreateAmenity(PointLocationOfAmenity=importosm_6.Points, Metadata=importosm_6.Metadata)
streetnet = CreateStreetNetwork(
    StreetCurves=flatten(pline_2),
    Metadata=flatten(importosm_5.Metadata),
    SplitStreetCurves=True,
    UTMZone=importosm_5.UTMZone,
    TranslationVector=importosm_5.TranslationVector)  # -> StreetNetwork, StreetSegmentCurves, UTMZone, TranslationVector
bldg = CreateBuilding(BuildingCurve=pline, Metadata=importosm_4.Metadata, AmenitiesInBuilding=amen)
model = BuildUrbanoModel(Buildings=flatten(bldg), StreetNetwork=streetnet.StreetNetwork, BuildToggle=False)  # -> UrbanoModel, BuildingCurves, Activities
inbldg = InspectBuilding(Building=bldg, UrbanoModel=model.UrbanoModel, DefaultHeight=10)  # -> Geometry, Metadata, Amenity, flatten(BuildingMesh)

panel_9 = Panel("Height")  # disabled
pline_3 = PolyLine(Vertices=importosm.Points, Closed=invert(False))  # disabled
pline_4 = PolyLine(Vertices=importosm_3.Points, Closed=False)  # disabled
street_metadata = StreetMetadata(CanWalk=True, CanBike=True, CanDrive=True)  # disabled
search_metadata = SearchMetadata()  # disabled
bldg_2 = CreateBuilding(BuildingCurve=pline_3, Metadata=importosm.Metadata)  # disabled
lookup = LookupMetadata(MetadataGeometry=import_osm_file.Polygons, SearchKey=panel_9)  # disabled
streetnet_2 = CreateStreetNetwork(
    StreetCurves=flatten(pline_4),
    Metadata=flatten(importosm_3.Metadata),
    SplitStreetCurves=True,
    UTMZone=importosm_3.UTMZone,
    TranslationVector=importosm_3.TranslationVector)  # -> StreetNetwork, StreetSegmentCurves, UTMZone, TranslationVector; disabled
swatch = ColourSwatch(SwatchColor=RGB(215, 222, 220))  # disabled
panel_10 = Panel(lookup)  # disabled
previewlw = CustomPreviewLineweights(Geometry=import_osm_file_2.Polylines, Shader=swatch, Absolute=False)  # disabled
model_2 = BuildUrbanoModel(Buildings=flatten(bldg_2), StreetNetwork=streetnet_2.StreetNetwork, BuildToggle=True)  # -> UrbanoModel, BuildingCurves, Activities; disabled
midpt = CurveMiddle(Curve=streetnet_2.StreetSegmentCurves)  # disabled
index = ItemIndex(List=streetnet_2.StreetSegmentCurves, Item=streetnet_2.StreetSegmentCurves)  # disabled
pt = Point(Point(596.3598875, 767.5411646, 0))  # disabled
pt_2 = Point(Point(1504.957871, 1141.907495, 0))  # disabled

# ---- group: New router gets more than one optimal route
number_slider = Slider(5, range=1..20)  # disabled
panel_11 = Panel("10.0")  # disabled
n_shortest_routes = Python3Script(Lines=import_osm_file_2.Polylines, StartPt=pt, EndPt=pt_2, Penalty=panel_11, K=number_slider)  # -> out, Routes, RouteIndices; inputs Lines: list of Curve, StartPt: Point3d, EndPt: Point3d, Penalty: Double, K: Int32; disabled
#   port Lines: Lines to convert to network.
#   port StartPt: Origin point.
#   port EndPt: Destination point.
#   port Penalty: Edge penalization to control how drastically the routes are forced to diverge. This, at the same time, forces the algorithm to give distinctive, alternative routes. A good starting point is 10.0
#   port Routes: Generated n routes.
#   port RouteIndices: Indices for line segments within routes.
# ---------- n_shortest_routes: Python ----------
#! python 3
# r: networkx

import rhinoscriptsyntax as rs
import Rhino.Geometry as rg
import networkx as nx

# NEW: Import Grasshopper's native Data Tree modules
import Grasshopper
from Grasshopper.Kernel.Data import GH_Path
import System

def get_distinct_paths_with_indices(curves, start_pt, end_pt, k, penalty_factor):
    if isinstance(curves, rg.Curve):
        curves = [curves]
        
    G = nx.Graph()
    
    def pt_to_key(pt):
        return (round(pt.X, 3), round(pt.Y, 3), round(pt.Z, 3))
        
    edge_geometries = {}
    edge_indices = {} 
    
    print("1. Building graph...")
    for original_idx, crv in enumerate(curves):
        if not crv: continue
        
        segments_to_process = []
        if crv.IsPolyline():
            success, polyline = crv.TryGetPolyline()
            if success:
                for seg in polyline.GetSegments():
                    segments_to_process.append(rg.LineCurve(seg))
        else:
            segments_to_process.append(crv)
            
        for seg_crv in segments_to_process:
            p1 = seg_crv.PointAtStart
            p2 = seg_crv.PointAtEnd
            
            k1 = pt_to_key(p1)
            k2 = pt_to_key(p2)
            
            length = seg_crv.GetLength()
            
            G.add_edge(k1, k2, weight=length)
            
            edge_geometries[(k1, k2)] = seg_crv
            edge_geometries[(k2, k1)] = seg_crv 
            edge_indices[(k1, k2)] = original_idx
            edge_indices[(k2, k1)] = original_idx
            
    if len(G.nodes) == 0:
        print("Error: No valid lines were provided.")
        return [], []

    def find_closest_node(graph, target_pt):
        closest_node = None
        min_dist = float('inf')
        for node in graph.nodes:
            node_pt = rg.Point3d(node[0], node[1], node[2])
            dist = target_pt.DistanceTo(node_pt)
            if dist < min_dist:
                min_dist = dist
                closest_node = node
        return closest_node

    start_key = find_closest_node(G, start_pt)
    end_key = find_closest_node(G, end_pt)
    
    k_paths_curves = []
    k_paths_indices = [] 
    
    print("2. Calculating distinctly penalized paths...")
    for i in range(k):
        try:
            path = nx.shortest_path(G, source=start_key, target=end_key, weight='weight')
            
            path_curves = []
            raw_path_indices = []
            
            for j in range(len(path) - 1):
                node_a = path[j]
                node_b = path[j+1]
                
                path_curves.append(edge_geometries[(node_a, node_b)])
                raw_path_indices.append(edge_indices[(node_a, node_b)])
                
                current_weight = G[node_a][node_b]['weight']
                G[node_a][node_b]['weight'] = current_weight * penalty_factor
                
            joined_curves = rg.Curve.JoinCurves(path_curves)
            if joined_curves:
                k_paths_curves.append(joined_curves[0])
                
                clean_indices = []
                for idx in raw_path_indices:
                    if not clean_indices or clean_indices[-1] != idx:
                        clean_indices.append(idx)
                
                k_paths_indices.append(clean_indices)
                
        except nx.NetworkXNoPath:
            print(f"Stopped early at {i} routes: No more valid alternative paths exist.")
            break
        except Exception as e:
            print("An error occurred: " + str(e))
            break
            
    print(f"Success: Found {len(k_paths_curves)} distinct routes.")
    
    # NEW: Convert the nested Python list into a strict Grasshopper Data Tree
    gh_tree = Grasshopper.DataTree[System.Object]()
    for branch_index, indices_list in enumerate(k_paths_indices):
        path = GH_Path(branch_index)
        for index_val in indices_list:
            gh_tree.Add(index_val, path)
            
    return k_paths_curves, gh_tree

if Lines and StartPt and EndPt and K and Penalty:
    Routes, RouteIndices = get_distinct_paths_with_indices(Lines, StartPt, EndPt, K, Penalty)
# ---------- end n_shortest_routes ----------
number_slider_2 = Slider(0, range=0..4)  # disabled
item = ListItem(List=n_shortest_routes.Routes, Index=number_slider_2, Wrap=invert(True))  # disabled
panel_12 = Panel(n_shortest_routes.RouteIndices)  # disabled

# ----
tag = TextTag(Location=midpt, Text=index)  # disabled
create_street_network = CreateStreetNetwork(
    StreetPolylines=import_osm_file_2.Polylines,
    CoordinateReference=import_osm_file_2.CoordinateReference,
    CleanStreets=True)  # -> StreetNetwork, CoordinateReference; disabled
lng = ListLength(List=n_shortest_routes.Routes)  # disabled
swatch_2 = ColourSwatch(SwatchColor=RGBA(2, 124, 153, 177))
index_2 = ItemIndex(List=n_shortest_routes.Routes, Item=n_shortest_routes.Routes)  # disabled
swatch_3 = ColourSwatch(SwatchColor=RGB(38, 137, 117))
swatch_4 = ColourSwatch(SwatchColor=RGB(98, 103, 104))
swatch_5 = ColourSwatch(SwatchColor=RGB(255, 0, 129))  # disabled
gradient = Gradient(
    LowerLimit=0,
    UpperLimit=lng,
    Parameter=index_2,
    stops=[0: RGB(243, 57, 0), 0.1: RGB(236, 27, 60), 0.2: RGB(210, 0, 118), 0.3: RGB(103, 0, 120), 0.4: RGB(39, 72, 161), 0.5: RGB(1, 192, 229), 0.6: RGB(18, 178, 90), 0.7: RGB(79, 186, 8), 0.8: RGB(220, 237, 32), 0.9: RGB(247, 159, 20), 1: RGB(243, 57, 0)])  # disabled
viewer = ParamViewer(n_shortest_routes.RouteIndices)  # disabled
argb = SplitARGB(Colour=swatch_4, IntegerChannels=True)  # -> Alpha, Red, Green, Blue

# ---- group: RESULTADOS / Huellas de edificios
crv = Curve(inbldg.Geometry)

# ---- group: RESULTADOS / Volumetrías
geo = Geometry(inbldg.BuildingMesh)

# ---- group: RESULTADOS / Red de calles
crv_2 = Curve(streetnet.StreetSegmentCurves)

# ---- group: Generate streets
swatch_6 = ColourSwatch(SwatchColor=RGB(0, 74, 117))
previewlw_2 = CustomPreviewLineweights(Geometry=crv_2, Shader=swatch_4, Absolute=False)

# ---- group: destination
pt_3 = Point(Point(5034.232252, 2606.704757, 0))  # disabled

# ---- group: origin
pt_4 = Point(Point(2486.27064, 2269.662603, 0))  # disabled

# ---- group: Origin vs Destination
pt_5 = Point(Point(162.4924354, 340.4718807, 0))
pt_6 = Point(Point(1441.880728, 2078.731361, 0))
dot = AnnotationDot(Location=pt_5, PrimaryText="Origen", TextHeight=Slider(12, range=0..100))  # -> AnnotationDot, Location, PrimaryText, SecondaryText, TextHeight, Font
dots = DotDisplay(Point=[pt_5, pt_6], Colour=ColourSwatch(SwatchColor=RGB(2, 205, 153)), Size=Slider(14, range=0..100))
dot_2 = AnnotationDot(AnnotationDot=dot.AnnotationDot, Location=pt_6, PrimaryText="Destino")  # -> AnnotationDot, Location, PrimaryText, SecondaryText, TextHeight, Font

# ----
number_slider_3 = Slider(3, range=0..10)  # disabled
rgb = ColourRGB(Alpha="153", Red=argb.Red, Green=argb.Green, Blue=argb.Blue)

# ---- group: Generate buildings
swatch_7 = ColourSwatch(SwatchColor=RGBA(2, 124, 153, 177))
swatch_8 = ColourSwatch(SwatchColor=RGBA(100, 103, 102, 159))
preview = CustomPreview(Geometry=geo, Material=rgb)

# ----
panel_13 = Panel(n_shortest_routes.out)  # disabled
betwcent = BetweennessCentrality(StreetNetwork=create_street_network.StreetNetwork)  # -> StreetSegments, BetweennessCentrality; disabled
router = Router(
    Origin=pt,
    Destination=pt_2,
    TravelMode="(0): Walk",
    StreetNetwork=create_street_network.StreetNetwork,
    CoordinateReference=create_street_network.CoordinateReference,
    RoutingMetric="Comprehensive (Default)")  # -> Route, TravelTime, TravelDistance, CoordinateReference; disabled
splitstr = SplitStreetCurves(SplitStreetCurves=flatten(crv_2), IntersectionTolerance=1e-12)  # -> ProcessedStreetCurves, Metadata

# ---- group: Street names
lookup_2 = LookupMetadata(MetadataGeometry=flatten(importosm_5.Metadata), SearchKey="name")
hframe = HorizontalFrame(Curve=reparameterize(splitstr.ProcessedStreetCurves), Parameter=Slider(0.5, range=0..1))
tag_2 = TextTag3D(
    Location=hframe,
    Text=lookup_2,
    Size=Slider(4, range=0..10),
    Colour=ColourSwatch(SwatchColor=RGB(0, 0, 0)),
    Justification=7)

# ---- group: Original Urbano router
router_2 = Router(RouterUrbanoModelOrStreetNetwork=model_2.UrbanoModel, Origin=pt_4, Destination=pt_3, TravelMode="car", TimeLimit=-1)  # -> Trip, Route, Time, Distance; disabled
crv_3 = Curve(router_2.Route)  # disabled

# ---- group: New router gets more than one optimal route
number_slider_4 = Slider(5, range=1..20)  # disabled
panel_14 = Panel("10.0")  # disabled
n_shortest_routes_2 = Python3Script(Lines=streetnet_2.StreetSegmentCurves, StartPt=pt_4, EndPt=pt_3, Penalty=panel_14, K=number_slider_4)  # -> out, Routes, RouteIndices; inputs Lines: list of Curve, StartPt: Point3d, EndPt: Point3d, Penalty: Double, K: Int32; disabled; same code as n_shortest_routes
number_slider_5 = Slider(1, range=0..4)  # disabled
item_2 = ListItem(List=n_shortest_routes_2.Routes, Index=number_slider_5, Wrap=invert(True))  # disabled
panel_15 = Panel(n_shortest_routes_2.RouteIndices)  # disabled

# ----
previewlw_3 = CustomPreviewLineweights(Geometry=n_shortest_routes.Routes, Shader=gradient, Thickness=number_slider_3, Absolute=False)  # disabled
explode = Explode(Curve=item, Recursive=True)  # -> Segments, Vertices; disabled
panel_16 = Panel(lookup_2)
midpt_2 = CurveMiddle(Curve=explode.Segments)  # disabled
explode_2 = Explode(Curve=splitstr.ProcessedStreetCurves, Recursive=True)  # -> flatten(Segments), Vertices
midpt_3 = CurveMiddle(Curve=explode_2.Segments)

# ---- group: select one branch
number_slider_6 = Slider(0, range=0..4)  # disabled
branch = BranchByIndex(Tree=n_shortest_routes_2.RouteIndices, Branch=number_slider_6)  # disabled
item_3 = ListItem(List=streetnet_2.StreetSegmentCurves, Index=branch, Wrap=True)  # disabled
midpt_4 = CurveMiddle(Curve=item_3)  # disabled
tag_3 = TextTag(Location=midpt_4, Text=branch)  # disabled

# ----
number_slider_7 = Slider(0, range=0..1)
lng_2 = ListLength(List=explode_2.Segments)
viewer_2 = ParamViewer(n_shortest_routes_2.RouteIndices)  # disabled
xytodd = XYToDecimalDegrees(XyPoint=midpt_3)  # -> Latitude, Longitude, Transform
number_of_segments = Panel(lng_2)
point_to_lat_lon = Python3Script(Point=midpt_3)  # -> out, LAT, LON; inputs Point: Point3d
# ---------- point_to_lat_lon: Python ----------
import math
import Rhino

# 1. Fetch the origin coordinates from the Rhino Document's Earth Anchor Point
eap = Rhino.RhinoDoc.ActiveDoc.EarthAnchorPoint
lat_origin = eap.EarthBasepointLatitude
lon_origin = eap.EarthBasepointLongitude
print(lat_origin)


# Constants for Earth's geometry (in meters)
M_PER_DEG_LAT = 111111.0
M_PER_DEG_LON_EQ = 111320.0

# 2. Calculate the change in Latitude (using the Y coordinate in meters)
delta_lat = Point.Y / M_PER_DEG_LAT
LAT = lat_origin + delta_lat
print(delta_lat)

# 3. Calculate the change in Longitude (using the X coordinate in meters)
# We must convert the origin latitude to radians to use math.cos()
lat_rad = math.radians(lat_origin)
delta_lon = Point.X / (M_PER_DEG_LON_EQ * math.cos(lat_rad))
LON = lon_origin + delta_lon
print(LAT)
print(LON)
# ---------- end point_to_lat_lon ----------

# ---- group: select one branch
item_4 = ListItem(List=streetnet_2.StreetSegmentCurves, Index=n_shortest_routes_2.RouteIndices, Wrap=True)  # disabled
midpt_5 = CurveMiddle(Curve=item_4)  # disabled
tag_4 = TextTag(Location=midpt_5, Text=n_shortest_routes_2.RouteIndices)  # disabled

# ----
swatch_9 = ColourSwatch(SwatchColor=RGB(255, 0, 129))
panel_17 = Panel(point_to_lat_lon.out)
panel_18 = Panel(point_to_lat_lon.LON)
panel_19 = Panel(point_to_lat_lon.LAT)

# ---- group: New router gets more than one optimal route / Sensations - options
myslider = Slider(3, range=0..5)

# ---- group: New router gets more than one optimal route
n_shortest_routes_3 = Python3Script(Lines=splitstr.ProcessedStreetCurves, StartPt=pt_5, EndPt=pt_6, Penalty="10.0", K=Slider(6, range=1..20))  # -> out, Routes, RouteIndices; inputs Lines: list of Curve, StartPt: Point3d, EndPt: Point3d, Penalty: Double, K: Int32; same code as n_shortest_routes
item_5 = ListItem(List=n_shortest_routes_3.Routes, Index=myslider, Wrap=invert(True))

# ----
viewer_3 = ParamViewer(n_shortest_routes_3.RouteIndices)
lng_3 = ListLength(List=n_shortest_routes_3.Routes)
index_3 = ItemIndex(List=n_shortest_routes_3.Routes, Item=n_shortest_routes_3.Routes)
branch_2 = BranchByIndex(Tree=n_shortest_routes_3.RouteIndices, Branch=Slider(0, range=0..10))
gradient_2 = Gradient(
    LowerLimit=0,
    UpperLimit=lng_3,
    Parameter=index_3,
    stops=[0: RGB(243, 57, 0), 0.1: RGB(236, 27, 60), 0.2: RGB(210, 0, 118), 0.3: RGB(103, 0, 120), 0.4: RGB(39, 72, 161), 0.5: RGB(1, 192, 229), 0.6: RGB(18, 178, 90), 0.7: RGB(79, 186, 8), 0.8: RGB(220, 237, 32), 0.9: RGB(247, 159, 20), 1: RGB(243, 57, 0)])
panel_20 = Panel(n_shortest_routes_3.RouteIndices)
len = Length(Curve=n_shortest_routes_3.Routes)
item_6 = ListItem(List=crv_2, Index=branch_2, Wrap=True)
explode_3 = Explode(Curve=item_2, Recursive=True)  # -> Segments, Vertices; disabled
panel_21 = Panel(len)
midpt_6 = CurveMiddle(Curve=explode_3.Segments)  # disabled
panel_22 = Panel(item_6)
panel_23 = Panel(gradient_2)
previewlw_4 = CustomPreviewLineweights(Geometry=n_shortest_routes_3.Routes, Shader=gradient_2, Thickness="7", Absolute=False)
len_2 = Length(Curve=item_5)

# ---- group: Selected path division and cylinder
explode_4 = Explode(Curve=item_5, Recursive=True)  # -> Segments, Vertices
midpt_7 = CurveMiddle(Curve=explode_4.Segments)
reduce = RandomReduce(List=midpt_7, Reduction=Slider(41, range=0..100), Seed=Slider(12, range=0..100))

divide = DivideCurve(Curve=item_5, Count=Slider(7, range=0..10), Kinks=False)  # -> Points, Tangents, Parameters

# ---- group: Color selected path and cylinder
item_7 = ListItem(List=gradient_2, Index=myslider, Wrap=True)
argb_2 = SplitARGB(Colour=item_7, IntegerChannels=True)  # -> Alpha, Red, Green, Blue
rgb_2 = ColourRGB(Alpha=Slider(124, range=0..255), Red=argb_2.Red, Green=argb_2.Green, Blue=argb_2.Blue)

# ---- group: Selected path division and cylinder
Z = UnitZ(Factor=1)
line = LineSDL(Start=divide.Points, Direction=Z, Length=Slider(50, range=0..100))
end = EndPoints(Curve=line)  # -> Start, End
cir = Circle(Plane=end.End, Radius=Slider(70, range=0..100))
Z_2 = UnitZ(Factor=Slider(40, range=0..100))
extr = Extrude(Base=cir, Direction=Z_2)
previewlw_5 = CustomPreviewLineweights(Geometry=line, Shader=item_7, Thickness="3", Absolute=False)
item_8 = ListItem(List=extr, Index=Slider(7, range=0..7), Wrap=True)
preview_2 = CustomPreview(Geometry=extr, Material=rgb_2)

# ----
number_slider_8 = Slider(59, range=0..100)  # disabled
number_slider_9 = Slider(1, range=1..3)  # disabled
path_distance = Panel(len_2)

# ---- group: Dot image sampling
number_slider_10 = Slider(100, range=0..100)  # disabled
number_slider_11 = Slider(200, range=1..200)  # disabled
srf = Surface(reparameterize(extr))  # disabled
panel_24 = Panel("10")  # disabled
division = Division(A=number_slider_11, B=panel_24)  # disabled
item_9 = ListItem(List=srf, Index=0, Wrap=True)  # disabled
sdivide = DivideSurface(Surface=srf, UCount=division, VCount=number_slider_11)  # -> Points, Normals, Parameters; disabled
pshift = ShiftPaths(Data=sdivide.Parameters, Offset=-1)  # disabled
pshift_2 = ShiftPaths(Data=sdivide.Points, Offset=-1)  # -> simplify(Data); disabled
bang = ExplodeTree(Data=pshift)  # -> Branch0, Branch1, Branch2, Branch3, Branch4, Branch5, Branch6, Branch7; disabled
image = ImageSampler(
    bang.Branch0,
    FilePath="C:\Users\l03063058\OneDrive - Instituto Tecnologico y de Estudios Superiores de Monterrey\TEC stuff\RESEARCH\10_experienceRouter\05_other docs\01_aviacion.PNG",
    Filter="Colour",
    Interpolate=False,
    Umax=1,
    Umin=0,
    Vmax=1,
    Vmin=0,
    Wrap=1)  # disabled
image_2 = ImageSampler(
    bang.Branch1,
    FilePath="C:\Users\l03063058\OneDrive - Instituto Tecnologico y de Estudios Superiores de Monterrey\TEC stuff\RESEARCH\10_experienceRouter\05_other docs\02.PNG",
    Filter="Colour",
    Interpolate=False,
    Umax=1,
    Umin=0,
    Vmax=1,
    Vmin=0,
    Wrap=1)  # disabled
image_3 = ImageSampler(
    bang.Branch5,
    FilePath="C:\Users\l03063058\OneDrive - Instituto Tecnologico y de Estudios Superiores de Monterrey\TEC stuff\RESEARCH\10_experienceRouter\05_other docs\06.PNG",
    Filter="Colour",
    Interpolate=False,
    Umax=1,
    Umin=0,
    Vmax=1,
    Vmin=0,
    Wrap=1)  # disabled
image_4 = ImageSampler(
    bang.Branch6,
    FilePath="C:\Users\l03063058\OneDrive - Instituto Tecnologico y de Estudios Superiores de Monterrey\TEC stuff\RESEARCH\10_experienceRouter\05_other docs\07.PNG",
    Filter="Colour",
    Interpolate=False,
    Umax=1,
    Umin=0,
    Vmax=1,
    Vmin=0,
    Wrap=1)  # disabled
image_5 = ImageSampler(
    bang.Branch2,
    FilePath="C:\Users\l03063058\OneDrive - Instituto Tecnologico y de Estudios Superiores de Monterrey\TEC stuff\RESEARCH\10_experienceRouter\05_other docs\03.PNG",
    Filter="Colour",
    Interpolate=False,
    Umax=1,
    Umin=0,
    Vmax=1,
    Vmin=0,
    Wrap=1)  # disabled
image_6 = ImageSampler(
    bang.Branch7,
    FilePath="C:\Users\l03063058\OneDrive - Instituto Tecnologico y de Estudios Superiores de Monterrey\TEC stuff\RESEARCH\10_experienceRouter\05_other docs\08.PNG",
    Filter="Colour",
    Interpolate=False,
    Umax=1,
    Umin=0,
    Vmax=1,
    Vmin=0,
    Wrap=1)  # disabled
image_7 = ImageSampler(
    bang.Branch4,
    FilePath="C:\Users\l03063058\OneDrive - Instituto Tecnologico y de Estudios Superiores de Monterrey\TEC stuff\RESEARCH\10_experienceRouter\05_other docs\05.PNG",
    Filter="Colour",
    Interpolate=False,
    Umax=1,
    Umin=0,
    Vmax=1,
    Vmin=0,
    Wrap=1)  # disabled
image_8 = ImageSampler(
    bang.Branch3,
    FilePath="C:\Users\l03063058\OneDrive - Instituto Tecnologico y de Estudios Superiores de Monterrey\TEC stuff\RESEARCH\10_experienceRouter\05_other docs\04.PNG",
    Filter="Colour",
    Interpolate=False,
    Umax=1,
    Umin=0,
    Vmax=1,
    Vmin=0,
    Wrap=1)  # disabled
entwine = Entwine(
    Branch00=image,
    Branch01=image_2,
    Branch02=image_5,
    Branch03=image_8,
    Branch04=image_7,
    Branch05=image_3,
    Branch06=image_4,
    Branch07=image_6,
    FlattenInputs=True)  # disabled
item_10 = ListItem(List=bang.Branch0, Index=0, Wrap=True)  # disabled
number_slider_12 = Slider(100, range=1..255)  # disabled
lng_4 = ListLength(List=bang.Branch0)  # disabled
argb_3 = SplitARGB(Colour=entwine, IntegerChannels=True)  # -> Alpha, Red, Green, Blue; disabled
panel_25 = Panel(lng_4)  # disabled
rgb_3 = ColourRGB(Alpha=number_slider_12, Red=argb_3.Red, Green=argb_3.Green, Blue=argb_3.Blue)  # -> simplify(Colour); disabled
toggle_2 = GroupToggle(ToggleActive=True, ToggleVisible=False)  # disabled
dots_2 = DotDisplay(Point=pshift_2, Colour=rgb_3, Size=1)  # disabled

# ----
# Visualize streets by type (based on OSM tags)
panel_26 = Panel("highway")  # disabled
lookup_metadata = LookupMetadata(MetadataGeometry=crv_2, SearchKey=panel_26)  # disabled
button = Button()  # disabled
urbano_gradient = UrbanoGradient(
    Reverse=button,
    stops=[0: RGB(243, 57, 0), 0.1: RGB(236, 27, 60), 0.2: RGB(210, 0, 118), 0.3: RGB(103, 0, 120), 0.4: RGB(39, 72, 161), 0.5: RGB(1, 192, 229), 0.6: RGB(18, 178, 90), 0.7: RGB(79, 186, 8), 0.8: RGB(220, 237, 32), 0.9: RGB(247, 159, 20), 1: RGB(243, 57, 0)])  # disabled
panel_27 = Panel("OSM Street Tag")  # disabled
panel_28 = Panel("0.5 to 5")  # disabled
map_settings = MapSettings(Gradient=urbano_gradient, Legend=False, LegendTitle=panel_27, Label=False, LinewidthRange=panel_28)  # disabled
draw_map_2 = DrawMap(Geometries=crv_2, Values=lookup_metadata, MapSettings=map_settings)  # disabled

# ----
# Visualize building by type (based on OSM tags)
panel_29 = Panel("building")  # disabled
lookup_metadata_2 = LookupMetadata(MetadataGeometry=geo, SearchKey=panel_29)  # disabled
button_2 = Button()  # disabled
urbano_gradient_2 = UrbanoGradient(
    Reverse=button_2,
    stops=[0: RGB(243, 57, 0), 0.1: RGB(247, 159, 20), 0.2: RGB(220, 237, 32), 0.3: RGB(79, 186, 8), 0.4: RGB(18, 178, 90), 0.5: RGB(1, 192, 229), 0.6: RGB(39, 72, 161), 0.7: RGB(103, 0, 120), 0.8: RGB(210, 0, 118), 0.9: RGB(236, 27, 60), 1: RGB(243, 57, 0)])  # disabled
panel_30 = Panel("OSM Building Tag")  # disabled
map_settings_2 = MapSettings(Gradient=urbano_gradient_2, Legend=True, LegendTitle=panel_30, Label=False)  # disabled
draw_map_3 = DrawMap(Geometries=geo, Values=lookup_metadata_2, MapSettings=map_settings_2)  # disabled

# ---- group: Generate "pulse"
number_slider_13 = Slider(500, range=0..1000)  # disabled
number_slider_14 = Slider(0, range=0..100)  # disabled
number_slider_15 = Slider(50, range=0..100)  # disabled
divide_2 = DivideCurve(Curve=item_5, Count=number_slider_13, Kinks=False)  # -> Points, Tangents, Parameters; disabled
lng_5 = ListLength(List=divide_2.Points)  # disabled
pdecon = Deconstruct(Point=divide_2.Points)  # -> XComponent, YComponent, ZComponent; disabled
dom = ConstructDomain(DomainStart=number_slider_14, DomainEnd=number_slider_15)  # disabled
random = Random(Range=dom, Number=lng_5, Seed=number_slider_8)  # disabled
pt_7 = ConstructPoint(XCoordinate=pdecon.XComponent, YCoordinate=pdecon.YComponent, ZCoordinate=random)  # disabled

# ----
intcrv = Interpolate(Vertices=pt_7, Degree=number_slider_9, Periodic=False, KnotStyle=1)  # -> Curve, Length, Domain; disabled

# ---- group: Fake affect percentage
number_slider_16 = Slider(69, range=0..100)  # disabled
Z_3 = UnitZ(Factor=1)  # disabled
number_slider_17 = Slider(12, range=0..100)  # disabled
line_2 = LineSDL(Start=midpt_7, Direction=Z_3, Length=number_slider_16)  # disabled
ccx = CurveCurve(CurveA=line_2, CurveB=intcrv.Curve)  # -> flatten(Points), ParamsA, ParamsB; disabled
Z_4 = UnitZ(Factor=number_slider_17)  # disabled
pdecon_2 = Deconstruct(Point=ccx.Points)  # -> XComponent, YComponent, ZComponent; disabled
move = Move(Geometry=ccx.Points, Motion=Z_4)  # -> Geometry, Transform; disabled
panel_31 = Panel("0 to 100")  # disabled
bnd = Bounds(Numbers=pdecon_2.ZComponent)  # disabled
number_slider_18 = Slider(5, range=0..10)  # disabled
number_slider_19 = Slider(23, range=0..100)  # disabled
remap = RemapNumbers(Value=pdecon_2.ZComponent, Source=bnd, Target=panel_31)  # -> Mapped, Clipped; disabled
round = Round(Number=remap.Mapped)  # -> Nearest, Floor, Ceiling; disabled
tag_5 = TextTag(Location=move.Geometry, Text=round.Nearest, Colour=item_7)  # disabled
dots_3 = DotDisplay(Point=ccx.Points, Colour=item_7, Size=number_slider_18)  # disabled
tag_6 = TextTag3D(Location=ccx.Points, Text=round.Nearest, Size=number_slider_19, Colour=item_7, Justification=7)  # disabled

# ---- group: Generate "pulse" (continued)
previewlw_6 = CustomPreviewLineweights(Geometry=intcrv.Curve, Shader=item_7, Absolute=False)  # disabled
